vi "Main.gviweb"   [LabVIEW NXG 2.1.0]
panel indicators:
  "Current Tempetrature": f64
  "Heater State": bool
  "Temperature Trend": f64[][]
  "Heater State Trend": i16[]
  "High Limit": f64
  "Low Limit": f64
uses:
  NI::HTTP::Open HTTP Handle.gvi
  NI::HTTP::GET.gvi
  NI::HTTP::Close HTTP Handle.gvi
diagram:
  call "Open HTTP Handle.gvi"(verify server=TRUE) -> (client handle out=w1, error out=w2)
  s1 = w1  # shift register
  s2 = w2  # shift register
  while {
    call "GET.gvi"(client handle=s1, url="http://192.168.0.73:8001/BoringWebServer/Get_Trend_Data", error in=s2) -> (client handle out=w3, body=w4, error out=w5)
    Unflatten From JSON(JSON string=w4, error in (no error)=w5, type and defaults=cluster{"trendData": string} {all zero or empty}) -> (error out=w6, value=w7)
    Property Node(instance in=w7) -> ("trendData"=w8)
    Unflatten From JSON(JSON string=w8, error in (no error)=w6, type and defaults=cluster{"h": f64, "l": f64, "c": f64, "s": bool}[] []) -> (error out=w9, value=w10)
    for {
      w11 = each element of w10
      Property Node(instance in=w11) -> ("h"=w16, "l"=w17, "c"=w18, "s"=w19)
      append w16 to w12
      append w17 to w13
      append w18 to w14
      append w19 to w15
    }
    $"Low Limit" <- w17
    $"High Limit" <- w16
    Build Array(w14, w13, w12) -> w20
    $"Temperature Trend" <- w20
    Boolean To Integer(Boolean=w15) -> (0, 1=w21)
    $"Heater State Trend" <- w21
    $"Heater State" <- w19
    $"Current Tempetrature" <- w18
    Wait(time to wait=1000)
    next s1 = w3
    next s2 = w9
    stop if FALSE
  }
  call "Close HTTP Handle.gvi"(client handle=s1, error in=s2)
